# Grasshopper definition logo.gh (Grasshopper 1.0.7)
# plug-ins: Bifocals

# ----
# Here to change size
number_slider = Slider(100, range=1..100)

# ----
# center of the box
number_slider_2 = Slider(2, range=0..10)
division = Division(A=number_slider, B=number_slider_2)
construct_point = ConstructPoint(XCoordinate=division, YCoordinate=division, ZCoordinate=division)

# ----
# Box
domain_box = DomainBox(Base=PlaneXY(0, 0, 0), X=number_slider, Y=number_slider, Z=number_slider)

# ----
# Cylinders' radius
number_slider_3 = Slider(4, range=0..10)
division_2 = Division(A=number_slider, B=number_slider_3)

# ----
# Find cylinders' axes
box_corners = BoxCorners(Box=domain_box)  # -> CornerA, CornerB, CornerC, CornerD, CornerE, CornerF, CornerG, CornerH
line = Line(StartPoint=box_corners.CornerA, EndPoint=box_corners.CornerE)
line_2 = Line(StartPoint=box_corners.CornerD, EndPoint=box_corners.CornerH)
line_3 = Line(StartPoint=box_corners.CornerB, EndPoint=box_corners.CornerF)
line_4 = Line(StartPoint=box_corners.CornerA, EndPoint=box_corners.CornerE)
curve_middle = CurveMiddle(Curve=line)
curve_middle_2 = CurveMiddle(Curve=line_2)
curve_middle_3 = CurveMiddle(Curve=line_4)
curve_middle_4 = CurveMiddle(Curve=line_3)
line_5 = Line(StartPoint=curve_middle, EndPoint=curve_middle_2)
line_6 = Line(StartPoint=curve_middle_4, EndPoint=curve_middle_3)

# ----
# All about box!
box_corners_2 = BoxCorners(Box=domain_box)  # -> CornerA, CornerB, CornerC, CornerD, CornerE, CornerF, CornerG, CornerH
line_7 = Line(StartPoint=box_corners_2.CornerF, EndPoint=box_corners_2.CornerG)
line_8 = Line(StartPoint=box_corners_2.CornerA, EndPoint=box_corners_2.CornerB)
line_9 = Line(StartPoint=box_corners_2.CornerD, EndPoint=box_corners_2.CornerH)
curve_middle_5 = CurveMiddle(Curve=line_8)
curve_middle_6 = CurveMiddle(Curve=line_9)
curve_middle_7 = CurveMiddle(Curve=line_7)
division_3 = Division(A=number_slider, B=Slider(6, range=0..10))
division_4 = Division(A=number_slider, B=Slider(-6, range=-6..-5))
box_2pt = Box2Pt(PointA=curve_middle_6, PointB=construct_point, Plane=PlaneXY(0, 0, 0))
box_2pt_2 = Box2Pt(PointA=curve_middle_7, PointB=construct_point, Plane=PlaneXY(0, 0, 0))
box_2pt_3 = Box2Pt(PointA=curve_middle_5, PointB=construct_point, Plane=PlaneXY(0, 0, 0))
unit_z = UnitZ(Factor=division_4)
unit_z_2 = UnitZ(Factor=division_3)
unit_x = UnitX(Factor=division_3)
unit_x_2 = UnitX(Factor=division_4)
unit_y = UnitY(Factor=division_4)
unit_y_2 = UnitY(Factor=division_3)
extrude = Extrude(Base=box_2pt_2, Direction=unit_y_2)
extrude_2 = Extrude(Base=box_2pt_2, Direction=unit_y)
extrude_3 = Extrude(Base=box_2pt, Direction=unit_z_2)
extrude_4 = Extrude(Base=box_2pt_3, Direction=unit_x_2)
extrude_5 = Extrude(Base=box_2pt, Direction=unit_z)
extrude_6 = Extrude(Base=box_2pt_3, Direction=unit_x)

# ----
# where cynlinders are
box_corners_3 = BoxCorners(Box=domain_box)  # -> CornerA, CornerB, CornerC, CornerD, CornerE, CornerF, CornerG, CornerH
line_10 = Line(StartPoint=box_corners_3.CornerA, EndPoint=box_corners_3.CornerF)
line_11 = Line(StartPoint=box_corners_3.CornerF, EndPoint=box_corners_3.CornerH)
line_12 = Line(StartPoint=box_corners_3.CornerA, EndPoint=box_corners_3.CornerH)
multiplication = Multiplication(A=number_slider, B=Slider(-1, range=-2..-1))
curve_middle_8 = CurveMiddle(Curve=line_12)
curve_middle_9 = CurveMiddle(Curve=line_11)
curve_middle_10 = CurveMiddle(Curve=line_10)
cylinder = Cylinder(Base=curve_middle_9, Radius=division_2, Length=multiplication)
cylinder_2 = Cylinder(Base=curve_middle_8, Radius=division_2, Length=multiplication)
cylinder_3 = Cylinder(Base=curve_middle_10, Radius=division_2, Length=multiplication)
radians = Radians(Degrees=Slider(270, range=0..360))
rotate_axis = RotateAxis(Geometry=cylinder_2, Angle=radians, Axis=line_5)  # -> Geometry, Transform
rotate_axis_2 = RotateAxis(Geometry=cylinder_3, Angle=radians, Axis=line_6)  # -> Geometry, Transform

# ----
# all the solids
solid_union = SolidUnion(Breps=[extrude_3, extrude_5, extrude_4, extrude_6, extrude, extrude_2])
solid_union_2 = SolidUnion(Breps=[cylinder, rotate_axis.Geometry, rotate_axis_2.Geometry])

# ----
# Final result
solid_difference = SolidDifference(BrepsA=domain_box, BrepsB=[solid_union, cylinder, solid_union_2])
